# Grasshopper definition example_plates.gh (Grasshopper 1.0.7)
# plug-ins: CadworkGrasshopper

axis = Axis(cwSelectedAxis=[0, 1, 0, 0, 0, 1])  # -> OutputAxis, VectorXLocal, VectorZLocal
selectbrep = SelectBrep(cwBreps="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")
expression = Expression(Expression="1")
expression_2 = Expression(Expression="-1")
shift_list = ShiftList(List=selectbrep, Shift=expression, Wrap=True)
shift_list_2 = ShiftList(List=selectbrep, Shift=expression_2, Wrap=True)
box_corners = BoxCorners(Box=selectbrep)  # -> CornerA, CornerB, CornerC, CornerD, CornerE, CornerF, CornerG, CornerH
deconstruct_brep = DeconstructBrep(Brep=selectbrep)  # -> Faces, flatten(Edges), Vertices
brep_brep = BrepBrep(BrepA=shift_list_2, BrepB=shift_list)  # -> Curves, Points
point = Point([box_corners.CornerF, box_corners.CornerG])
deconstruct = Deconstruct(Point=deconstruct_brep.Vertices)  # -> XComponent, YComponent, ZComponent
surface = Surface(deconstruct_brep.Faces)
shift_list_3 = ShiftList(List=point, Shift=Slider(4, range=0..10), Wrap=True)
area = Area(Geometry=surface)  # -> Area, Centroid
sort_list = SortList(Keys=deconstruct.ZComponent, ValuesA=deconstruct_brep.Vertices)  # -> Keys, ValuesA
line = Line(StartPoint=point, EndPoint=shift_list_3)
sort_list_2 = SortList(Keys=flatten(area.Area), ValuesValuesA=flatten(surface))  # -> Keys, ValuesValuesA
list_length = ListLength(List=sort_list.ValuesA)  # -> expr("x * 0.5", Length)
length = Length(Curve=line)
subtraction = Subtraction(A=list_length, B=1)
panel = Panel(sort_list_2.Keys)
sort_list_3 = SortList(Keys=length, ValuesValuesA=line)  # -> Keys, ValuesValuesA
range = Range(Domain=subtraction, Steps=subtraction)
cull_index = CullIndex(List=sort_list.ValuesA, Indices=range, Wrap=True)
end_points = EndPoints(Curve=sort_list_3.ValuesValuesA)  # -> Start, End
point_2 = Point(cull_index)
cull_duplicates = CullDuplicates(Points=[end_points.Start, end_points.End], Tolerance=0.1, CullMode=3)  # -> Points, Indices, Valence
deconstruct_2 = Deconstruct(Point=point_2)  # -> XComponent, YComponent, ZComponent
shift_list_4 = ShiftList(List=point, Shift=Slider(4, range=0..10), Wrap=True)
sort_list_4 = SortList(Keys=deconstruct_2.YComponent, ValuesA=point_2)  # -> Keys, ValuesA
shift_list_5 = ShiftList(List=sort_list_4.ValuesA, Shift=Slider(2, range=0..10), Wrap=True)
line_2 = Line(StartPoint=point, EndPoint=shift_list_4)
line_3 = Line(StartPoint=sort_list_4.ValuesA, EndPoint=shift_list_5)
